# Requirement set TransitionFlyby (R2021b)

## 1 [GUID-FUNC-5] The system shall determine the fly-by transitions
The fly-by transitions are used to turn in nominal cases

### 1.1 [GUID-FUNC-5.1] The systeme shall compute transition parameters of the fly-by transition

#### 1.1.1 [GUID-FUNC-5.1.1] The system shall compute the track change (alpha) between two legs in degrees.
Comments :
This function’s inputs are two given legs. The track change is the angle between the two legs considered.
Rationale: The track change between two legs is used as an input for the calculation of a transition.

#### 1.1.2 [#8]

### 1.2 [GUID-FUNC-5.2] The system shall build the reference lateral path of the plane.
Assumption:
The reference lateral path corresponds to the actual path meant to be flown by the aircraft.
Rationale: The reference lateral path is an information sent to the autopilot, and send to be displayed by the EFIS.

### 1.3 [GUID-FUNC-5.3] The system shall compute the automatic sequencing conditions.
The system shall compute the automatic sequencing conditions. When the Transition is a Fly-by, the sequencing condition is the line equation between the virtual turn center of the Transition and the active waypoint, referenced as the bisector of the Transition. It is hence a function of the aircraft coordinates and will be noted by f(x,y).
Assumption :
Sequencing conditions take into account if the system is on HDG or NAV mode
Comments :
This function’s inputs are the reference lateral , the active Leg and the aircraft position. The turn center and active waypoint are known from the reference lateral .
Rationale: The sequencing condition gives the line equation in order to know when the aircraft reaches the middle of the Transition.