# Requirement set guidance (R2021b)

## 1 [GUID-FUNC]

### 1.1 [GUID-FUNC-1] The system shall know the active leg at all times

### 1.2 [GUID-FUNC-3] The system shall compiute the distance between the aircraft's current position and the active waypoint.

### 1.3 [GUID-FUNC-2] The system shall compute transitions and follow the progress of the active leg

### 1.4 [GUID-FUNC-4] The system shall manage complex transitions and discontinuity cases
Assumption:
The function is not provided at the moment, TODO in further versions
Rationale: The system has to provide a flyable reference path, even if a leg is too short to connect the fly-by transition.

### 1.5 [GUID-FUNC-5] The system shall determine the fly-by transitions
The fly-by transitions are used to turn in nominal cases

### 1.6 [GUID-FUNC-6] The system shall determine the fly-over transitions
Rationale: The fly-over transitions are used when asked